# Dynamo graph MultiplyBoreholes.dyn "MultipleBareholes" (Dynamo 2.4.1.6326)

# group: Hole(Location Details).xlsx file
file_path = Filename("No file selected.")
file_from_path = FileObject(path=file_path)
string = StringInput("HOLE")
boolean = BoolSelector(false)
importExcel = Data.ImportExcel(file=file_from_path, sheetName=string, showExcel=boolean)

cleanAList = Python(IN[0]=importExcel)
# ---------- cleanAList.python (14 lines) ----------
# Load the Python Standard and DesignScript Libraries
import sys
import clr

Locations = IN[0]

# Assign your output to the OUT variable.
ENLst=[]
for eachItem in Locations:
	if eachItem[0] != None:
		ENLst.Add(eachItem)
	else:
		break
OUT = ENLst
# ----------------------------------------
firstItem = List.FirstItem(list=cleanAList)
file_path_2 = Filename("No file selected.")
restOfItems = List.RestOfItems(list=cleanAList)
number = DoubleInput(0)
getItemAtIndex = List.GetItemAtIndex(list=restOfItems, index=number, lacing=Longest)
string_2 = StringInput("Gr")
string_3 = StringInput("Pgl")
replace = String.Replace(str=getItemAtIndex, searchFor=string_2, replaceWith=string_3)
number_2 = DoubleInput(1)
getItemAtIndex_2 = List.GetItemAtIndex(list=restOfItems, index=number_2, lacing=Longest)
current = Autodesk.AutoCAD.DynamoNodes.Document.Current()
alignments = Alignments(document=current)
python_script = Python(IN[0]=restOfItems)
# ---------- python_script.python (20 lines) ----------
# Load the Python Standard and DesignScript Libraries
import sys
import clr

Locations = IN[0]

# Assign your output to the OUT variable.
ENLst=[]
elst =[]
nlst = []
zlst = []
for eachItem in Locations:
	elst.append(eachItem[2])
	nlst.append(eachItem[3])
	zlst.append(eachItem[4])
	
ENLst.Add(elst)
ENLst.Add(nlst)
ENLst.Add(zlst)
OUT = ENLst
# ----------------------------------------
number_3 = DoubleInput(0)
getItemAtIndex_3 = List.GetItemAtIndex(list=python_script, index=number_3)
number_4 = DoubleInput(1)
getItemAtIndex_4 = List.GetItemAtIndex(list=python_script, index=number_4)
number_5 = DoubleInput(2)
getItemAtIndex_5 = List.GetItemAtIndex(list=python_script, index=number_5)
byCoordinates = Point.ByCoordinates(x=getItemAtIndex_3, y=getItemAtIndex_4, z=getItemAtIndex_5)
stationOffsetByPoint = Autodesk.Civil.DynamoNodes.Alignment.StationOffsetByPoint(alignment=alignments, point=byCoordinates, lacing=Longest)

# group: Enter an offset value here:
bareHoleOffsetValue = DoubleSlider(15, range=0..50 step 0.5)

left = Python(IN[0]=stationOffsetByPoint.Offset, IN[1]=bareHoleOffsetValue)
# ---------- left.python (13 lines) ----------
# Load the Python Standard and DesignScript Libraries
import sys
import clr

Locations = IN[0]
v=IN[1]
l=[]
r=[]
# Assign your output to the OUT variable.
i =0
for eachItem in Locations:
	l.append(eachItem-v)
OUT = l
# ----------------------------------------
coordinateSystemByStationOffset = Autodesk.Civil.DynamoNodes.Alignment.CoordinateSystemByStationOffset(alignment=alignments, station=stationOffsetByPoint.Station, offset=left, lacing=Longest)
origin = CoordinateSystem.Origin(coordinateSystem=coordinateSystemByStationOffset)
X = Point.X(point=origin)
Y = Point.Y(point=origin)
number_6 = DoubleInput(4)
getItemAtIndex_6 = List.GetItemAtIndex(list=restOfItems, index=number_6, lacing=Longest)
number_7 = DoubleInput(5)
getItemAtIndex_7 = List.GetItemAtIndex(list=restOfItems, index=number_7, lacing=Longest)
number_8 = DoubleInput(6)
getItemAtIndex_8 = List.GetItemAtIndex(list=restOfItems, index=number_8, lacing=Longest)
number_9 = DoubleInput(7)
getItemAtIndex_9 = List.GetItemAtIndex(list=restOfItems, index=number_9, lacing=Longest)
list_create = List.Create(item0=replace, item1=getItemAtIndex_2, item2=X, item3=Y, item4=getItemAtIndex_6, item5=getItemAtIndex_7, item6=getItemAtIndex_8, item7=getItemAtIndex_9)
transpose = List.Transpose(lists=list_create)
string_4 = StringInput("Pgr")
replace_2 = String.Replace(str=getItemAtIndex, searchFor=string_2, replaceWith=string_4)
right = Python(IN[0]=stationOffsetByPoint.Offset, IN[1]=bareHoleOffsetValue)
# ---------- right.python (12 lines) ----------
# Load the Python Standard and DesignScript Libraries
import sys
import clr

Locations = IN[0]
v=IN[1]
r=[]
# Assign your output to the OUT variable.
i =0
for eachItem in Locations:
	r.append(eachItem+v)
OUT = r
# ----------------------------------------
coordinateSystemByStationOffset_2 = Autodesk.Civil.DynamoNodes.Alignment.CoordinateSystemByStationOffset(alignment=alignments, station=stationOffsetByPoint.Station, offset=right, lacing=Longest)
origin_2 = CoordinateSystem.Origin(coordinateSystem=coordinateSystemByStationOffset_2)
X_2 = Point.X(point=origin_2)
Y_2 = Point.Y(point=origin_2)
list_create_2 = List.Create(item0=replace_2, item1=getItemAtIndex_2, item2=X_2, item3=Y_2, item4=getItemAtIndex_6, item5=getItemAtIndex_7, item6=getItemAtIndex_8, item7=getItemAtIndex_9)
transpose_2 = List.Transpose(lists=list_create_2)
list_create_3 = List.Create(item0=cleanAList, item1=transpose, item2=transpose_2)
number_10 = DoubleInput(1)
flatten = List.Flatten(list=list_create_3, amt=number_10)
exportCSV = Data.ExportCSV(filePath=file_path_2, data=flatten)
file_path_3 = Filename("No file selected.")

# group: Geol(Field Geological Descriptions).xlsx file
file_path_4 = Filename("No file selected.")
file_from_path_2 = FileObject(path=file_path_4)
string_5 = StringInput("GEOL")
boolean_2 = BoolSelector(false)
importExcel_2 = Data.ImportExcel(file=file_from_path_2, sheetName=string_5, showExcel=boolean_2)

cleanAList_2 = Python(IN[0]=importExcel_2)  # same code as cleanAList
restOfItems_2 = List.RestOfItems(list=cleanAList_2)
number_11 = DoubleInput(0)
getItemAtIndex_10 = List.GetItemAtIndex(list=restOfItems_2, index=number_11, lacing=Longest)
string_6 = StringInput("Gr")
string_7 = StringInput("Pgl")
replace_3 = String.Replace(str=getItemAtIndex_10, searchFor=string_6, replaceWith=string_7)
number_12 = DoubleInput(1)
getItemAtIndex_11 = List.GetItemAtIndex(list=restOfItems_2, index=number_12, lacing=Longest)
number_13 = DoubleInput(2)
getItemAtIndex_12 = List.GetItemAtIndex(list=restOfItems_2, index=number_13, lacing=Longest)
number_14 = DoubleInput(3)
getItemAtIndex_13 = List.GetItemAtIndex(list=restOfItems_2, index=number_14, lacing=Longest)
number_15 = DoubleInput(4)
getItemAtIndex_14 = List.GetItemAtIndex(list=restOfItems_2, index=number_15, lacing=Longest)
number_16 = DoubleInput(5)
getItemAtIndex_15 = List.GetItemAtIndex(list=restOfItems_2, index=number_16, lacing=Longest)
number_17 = DoubleInput(6)
getItemAtIndex_16 = List.GetItemAtIndex(list=restOfItems_2, index=number_17, lacing=Longest)
number_18 = DoubleInput(7)
getItemAtIndex_17 = List.GetItemAtIndex(list=restOfItems_2, index=number_18, lacing=Longest)
number_19 = DoubleInput(8)
getItemAtIndex_18 = List.GetItemAtIndex(list=restOfItems_2, index=number_19, lacing=Longest)
list_create_4 = List.Create(item0=replace_3, item1=getItemAtIndex_11, item2=getItemAtIndex_12, item3=getItemAtIndex_13, item4=getItemAtIndex_14, item5=getItemAtIndex_15, item6=getItemAtIndex_16, item7=getItemAtIndex_17, item8=getItemAtIndex_18)
transpose_3 = List.Transpose(lists=list_create_4)
string_8 = StringInput("Pgr")
replace_4 = String.Replace(str=getItemAtIndex_10, searchFor=string_6, replaceWith=string_8)
list_create_5 = List.Create(item0=replace_4, item1=getItemAtIndex_11, item2=getItemAtIndex_12, item3=getItemAtIndex_13, item4=getItemAtIndex_14, item5=getItemAtIndex_15, item6=getItemAtIndex_16, item7=getItemAtIndex_17, item8=getItemAtIndex_18)
transpose_4 = List.Transpose(lists=list_create_5)
list_create_6 = List.Create(item0=cleanAList_2, item1=transpose_3, item2=transpose_4)
number_20 = DoubleInput(1)
flatten_2 = List.Flatten(list=list_create_6, amt=number_20)
exportCSV_2 = Data.ExportCSV(filePath=file_path_3, data=flatten_2)
bySweep2Rails = Solid.BySweep2Rails()  # unwired: path, guideRail, profile
